# Grasshopper definition FlatNozzle_adaptive_rotation.gh (Grasshopper 1.0.7)
# plug-ins: Pufferfish

crv = Curve(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)
points_count = Slider(30, range=0..100)
move_nozzle = Slider(71, range=0..100)
hframes = HorizontalFrames(Curve=crv, Count=points_count)  # -> Frames, Parameters

# ---- group: Tan display
divide = DivideCurve(Curve=crv, Count=points_count, Kinks=False)  # -> Points, Tangents, Parameters
amp = Amplitude(Vector=divide.Tangents, Amplitude=Slider(6, range=0..100))
vdis = VectorDisplay(Anchor=divide.Points, Vector=amp)

# ----
rectangle = Rectangle(Plane=hframes.Frames, XSize=Domain(-1, 1), YSize=Domain(-2, 2), Radius=0)  # -> Rectangle, Length

# ---- group: Dir Vec
deplane = DeconstructPlane(Plane=hframes.Frames)  # -> Origin, XAxis, YAxis, ZAxis
vec = VectorXYZ(XComponent=deplane.XAxis, YComponent=0, ZComponent=0)  # -> Vector, Length
amp_2 = Amplitude(Vector=vec.Vector, Amplitude=Slider(5, range=0..100))
vdis_2 = VectorDisplay(Anchor=deplane.Origin, Vector=amp_2)

# ----
boundary = BoundarySurfaces(Edges=rectangle.Rectangle)
item = ListItem(List=rectangle.Rectangle, Index=move_nozzle, Wrap=True)
item_2 = ListItem(List=divide.Points, Index=Slider(30, range=0..30), Wrap=True)
area = Area(Geometry=item)  # -> Area, Centroid

# ---- group: Nozzle Mesh
brep = Brep(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)
volume = Volume(Geometry=brep)  # -> Volume, Centroid
mesh = Mesh(brep)
move2pt = MoveToPoint(Geometry=mesh, PointA=volume.Centroid, PointB=area.Centroid)  # -> Moved, Vector, Transform

# ----
msphere = MeshSphere(Base=item_2, Radius=2, UCount=10, VCount=20)
angle = Angle(VectorA=amp, VectorB=amp_2)  # -> Angle, Reflex

# ---- group: Flip angle
deg = Degrees(Radians=angle.Angle)
python = GhPythonScript(a=deg)  # -> out, angles; inputs a: list
# ---------- python: Python ----------
angles = []

first = True

alpha_p = 0
for idx, val in enumerate(a):
    if first:
        first = False
    else:
        if val > val_p:
            a[idx] = -val
    angles.append(a[idx])
    val_p = a[idx]
# ---------- end python ----------
item_3 = ListItem(List=angle.Angle, Index=move_nozzle, Wrap=True)
rad = Radians(Degrees=python.angles)

# ----
pdecon = Deconstruct(Point=flatten(divide.Points))  # -> XComponent, YComponent, ZComponent
multiplication = Multiplication(A="20", B="60")
multiplication_2 = Multiplication(A=deg, B="0.025")
concat = Concatenate(
    FragmentA="G1",
    FragmentB=" F",
    FragmentC=multiplication,
    FragmentD=" X",
    FragmentE=pdecon.XComponent,
    FragmentF=" Y",
    FragmentG=pdecon.YComponent,
    FragmentH=" Z",
    FragmentI=pdecon.ZComponent,
    FragmentJ=" E",
    FragmentK=multiplication_2)
merge = Merge(Data2=concat)
panel = Panel(merge)

# ---- group: Viz Nozzle
Z = UnitZ(Factor=Slider(12, range=0..100))
move = Move(Geometry=move2pt.Moved, Motion=Z)  # -> Geometry, Transform
rotate = Rotate(Geometry=move.Geometry, Angle=item_3, Plane=area.Centroid)  # -> Geometry, Transform
preview = CustomPreview(Geometry=rotate.Geometry, Material=ColourSwatch(SwatchColor=RGB(157, 26, 186)))

# ---- group: Ideal Angle
rad_2 = Radians(Degrees=Slider(-21, range=-180..180))
Z_2 = UnitZ(Factor=Slider(12, range=0..100))
move_2 = Move(Geometry=move2pt.Moved, Motion=Z_2)  # -> Geometry, Transform
item_4 = ListItem(List=rad_2, Index=move_nozzle, Wrap=True)
rotate_2 = Rotate(Geometry=move_2.Geometry, Angle=item_4, Plane=area.Centroid)  # -> Geometry, Transform
preview_2 = CustomPreview(
    Geometry=rotate_2.Geometry,
    Material={diffuse=RGB(221, 160, 221), emission=RGB(66, 48, 66), shine=0.5, specular=RGB(255, 255, 255), transparency=0})

# ----
panel_2 = Panel(deg)
panel_3 = Panel(python.angles)
deg_2 = Degrees(Radians=angle.Angle)
tag = TextTag3D(Location=hframes.Frames, Text=deg_2, Size=1, Colour=ColourSwatch(SwatchColor=RGB(255, 255, 255)), Justification=7)
